# Grasshopper definition sp2503_10191459_最終.gh (Grasshopper 1.0.8)

# ----
# 樽概形パラメータ
樽概形_端部の直径 = Slider(644, range=200..800)
樽概形_高さ = Slider(770, range=200..1000)
樽概形_中央の直径 = Slider(732, range=200..800)

panel = Panel("""0.20944
0.20944
0.20944+0.20944/3
0.20944
0.20944
0.20944
0.20944
0.20944
0.20944
0.20944
0.20944
0.20944+0.20944/3
0.20944
0.20944
0.20944
0.20944
0.20944
0.20944
0.20944
0.20944+0.20944/3
0.20944
0.20944
0.20944
0.20944
0.20944
0.20944
0.20944
0.20944
0.20944""")

# ----
# 1. Rhinoで基準点を作成
基準点_樽 = Point(<point referenced from the Rhino model>)
基準点_治具 = Point(<point referenced from the Rhino model>)
基準点_樽板図面 = Point(<point referenced from the Rhino model>)

# ----
# 2. モデル・図面のレイアウトの変数を入力
レイアウト_治具_unique間隔 = Slider(1500, range=0..10000)
レイアウト_治具_ab間隔 = Slider(500, range=0..10000)
レイアウト_樽板図面_unique間隔 = Slider(1500, range=0..10000)

# ----
# 3.CSVファイルを選択
csvファイルパス = FilePath("C:\Users\kitwk\OneDrive - 国立大学法人 北海道大学\ドキュメント\JPHACKS\BarrelSizeTable_UKRver_Rev20251019.csv")

# ----
# 5. 樽板の変数を入力
樽板_厚 = Slider(20, range=0..100)

# ----
# 6. 樽の分割角度を入力
panel_2 = Panel(panel)

# ----
# 7. 溝の変数を入力
溝_樽端部から溝芯までの距離 = Slider(30, range=10..40)
溝_幅 = Slider(4, range=0..5)
溝_深さ = Slider(4, range=0..5)

# ----
# 8. 鏡板の変数を入力
鏡板_厚 = Slider(22, range=10..30)

# ----
# 9. 治具の変数を入力
治具_厚 = Slider(15, range=0..30)
治具共通_突起最小幅 = Slider(10, range=0..30)
治具共通_突起段差 = Slider(2, range=0..30)
治具共通_クランプ基部長さ = Slider(70, range=0..100)

# ----
# ユーザー入力
rhino許容誤差 = Slider(0.001, range=0..1)
基準点_樽_2 = Point(基準点_樽)
分割角度リスト = Number(panel_2)
addition = Addition(A=rhino許容誤差, B=1)
rhino許容誤差_1_tol = Number(addition)
樽概形_中央の直径_2 = Number(樽概形_中央の直径)
rhino許容誤差_2 = Number(rhino許容誤差)
分割角度リスト_2 = Number(panel_2)
溝_樽端部から溝芯までの距離_2 = Number(溝_樽端部から溝芯までの距離)
基準点_樽_3 = Point(基準点_樽)
溝_樽端部から溝芯までの距離_3 = Number(溝_樽端部から溝芯までの距離)
溝_深さ_2 = Number(溝_深さ)
溝_幅_2 = Number(溝_幅)

# ----
# Method: 基準点から樽分割線への角度・ベクトル
ma = MassAddition(Input=分割角度リスト_2)  # -> Result, PartialResults
ins = InsertItems(List=ma.PartialResults, Item="0", Indices="0", Wrap=True)
cull_i = CullIndex(List=ins, Indices=-1, Wrap=True)
addition_2 = Addition(A=ma.PartialResults, B=cull_i)
division = Division(A=addition_2, B=2)
X = UnitX(Factor=1)
Z = UnitZ(Factor=1)
vrot = Rotate(Vector=X, Axis=Z, Angle=division)  # -> simplify(graft(Vector))

rhino許容誤差_1_tol_2 = Number(addition)
基準点_樽_4 = Point(基準点_樽)
鏡板_厚_2 = Number(鏡板_厚)
鏡板_厚_3 = Number(鏡板_厚)
溝_樽端部から溝芯までの距離_4 = Number(溝_樽端部から溝芯までの距離)
基準点_樽_5 = Point(基準点_樽)
樽板_厚_2 = Number(樽板_厚)
分割角度リスト_3 = Number(panel_2)
基準点_樽_6 = Point(基準点_樽)
レイアウト_治具_unique間隔_2 = Number(レイアウト_治具_unique間隔)
レイアウト_治具_ab間隔_2 = Number(レイアウト_治具_ab間隔)
基準点_治具_2 = Point(基準点_治具)
レイアウト_樽図面_unique間隔 = Number(レイアウト_樽板図面_unique間隔)
基準点_樽板図面_2 = Point(基準点_樽板図面)
as_text = AnnotationTextSettings(TextHeight=Slider(0.1, range=0..1), TextGap=0.01, FitText=1)  # -> TextSettings, Font, TextHeight, TextGap, Mask, MaskColour, MaskMargins, MaskFrame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
as_arrows = AnnotationArrowSettings(Arrow1=3, Arrow2=3, ArrowSize=0.015)  # -> ArrowSettings, Arrow1, Arrow2, ArrowSize, FitArrow, DimensionInline, LeaderArrow, LeaderArrowSize
as_dimension = AnnotationDimensionSettings(
    ViewOriented=False,
    TextLocation=0,
    TextRotation=2,
    RadialTextRotation=0,
    ExtensionLineExtension=0,
    ExtensionLineOffset=0,
    FixedExtension=False)  # -> DimensionSettings, ViewOriented, TextLocation, TextRotation, RadialViewOriented, RadialTextLocation, RadialTextRotation, DimensionLineExtension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
治具_厚_2 = Number(治具_厚)
治具共通_突起最小幅_2 = Number(治具共通_突起最小幅)
治具共通_突起段差_2 = Number(治具共通_突起段差)
治具_厚_3 = Number(治具_厚)
xy = XYPlane(Origin=Point(0, 0, 0))
as_dimension_2 = AnnotationDimensionSettings(
    ViewOriented=False,
    TextLocation=0,
    TextRotation=2,
    RadialTextRotation=0,
    DimensionLineExtension=Slider(0.05, range=0..1),
    ExtensionLineExtension=Slider(0.05, range=0..1),
    ExtensionLineOffset=Slider(0.05, range=0..1),
    FixedExtension=False)  # -> DimensionSettings, ViewOriented, TextLocation, TextRotation, RadialViewOriented, RadialTextLocation, RadialTextRotation, DimensionLineExtension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
neg = Negative(Value=Slider(26.377, range=0..100))
治具a_スケーリング = Slider(3, range=0..5)
number_slider = Slider(10, range=0..100)
治具共通_クランプ基部長さ_2 = Number(治具共通_クランプ基部長さ)
治具a_スケーリング_2 = Number(治具a_スケーリング)
as_text_2 = AnnotationTextSettings(TextHeight=Slider(0.05, range=0..1), TextGap=0.01, FitText=1)  # -> TextSettings, Font, TextHeight, TextGap, Mask, MaskColour, MaskMargins, MaskFrame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
as_dimension_3 = AnnotationDimensionSettings(
    ViewOriented=False,
    TextLocation=0,
    TextRotation=2,
    RadialTextRotation=0,
    ExtensionLineExtension=0,
    ExtensionLineOffset=Slider(0.05, range=0..0.1),
    FixedExtension=False)  # -> DimensionSettings, ViewOriented, TextLocation, TextRotation, RadialViewOriented, RadialTextLocation, RadialTextRotation, DimensionLineExtension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
as_arrows_2 = AnnotationArrowSettings(Arrow1=0, Arrow2=0, ArrowSize=0.015)  # -> ArrowSettings, Arrow1, Arrow2, ArrowSize, FitArrow, DimensionInline, LeaderArrow, LeaderArrowSize
治具共通_突起段差_3 = Number(治具共通_突起段差)
swatch = ColourSwatch(SwatchColor=RGB(0, 0, 0))
material = CreateMaterial(Diffuse=swatch, Specular=swatch, Emission=ColourSwatch(SwatchColor=RGB(255, 255, 255)), Transparency=0, Shine=0)

# ----
# 4. 樽の種類（容積[L]）を選択
樽種を選択 = Slider(3, range=0..5)

# ----
# Method: CSVをインポート
read_file = ReadFile(File=csvファイルパス, PerLineParse=True)
text_split = TextSplit(Text=read_file, Separators=",")  # -> simplify(Result)
tree_statistics = TreeStatistics(Tree=text_split)  # -> Paths, Length, Count
cull_index = CullIndex(List=tree_statistics.Paths, Indices=0, Wrap=True)
tree_branch = TreeBranch(Tree=text_split, Path=cull_index, MaintainPaths=False)
list_item = ListItem(List=tree_branch, Index=0, Wrap=True)  # -> flatten(Item)
flip_matrix = FlipMatrix(Data=tree_branch)  # -> simplify(Data)
list_item_2 = ListItem(List=tree_statistics.Paths, Index=1, Wrap=True)
list_item_3 = ListItem(List=tree_statistics.Paths, Index=2, Wrap=True)
list_item_4 = ListItem(List=tree_statistics.Paths, Index=3, Wrap=True)
tree_branch_2 = TreeBranch(Tree=flip_matrix, Path=list_item_2, MaintainPaths=True)
tree_branch_3 = TreeBranch(Tree=flip_matrix, Path=list_item_3, MaintainPaths=True)
tree_branch_4 = TreeBranch(Tree=flip_matrix, Path=list_item_4, MaintainPaths=True)
list_item_5 = ListItem(List=tree_branch_2, Index=樽種を選択, Wrap=True)
list_item_6 = ListItem(List=tree_branch_3, Index=樽種を選択, Wrap=True)
list_item_7 = ListItem(List=tree_branch_4, Index=樽種を選択, Wrap=True)

樽の容積一覧_l = Panel(list_item)
item = ListItem(List=樽の容積一覧_l, Index=樽種を選択, Wrap=True)
選択されている樽の容積 = Panel(item)

division_2 = Division(A=list_item_5, B=2)
division_3 = Division(A=list_item_7, B=2)
division_4 = Division(A=list_item_6, B=2)

# ----
# Method: 端部・中央の基準円を作成
Z_2 = UnitZ(Factor=division_2)
move = Move(Geometry=基準点_樽_2, Motion=Z_2)  # -> Geometry, Transform
cir = Circle(Plane=基準点_樽_2, Radius=division_3)
cir_2 = Circle(Plane=move.Geometry, Radius=division_4)
Z_3 = UnitZ(Factor=list_item_5)
move_2 = Move(Geometry=cir, Motion=Z_3)  # -> Geometry, Transform
entwine = Entwine(Branch00=cir, Branch01=cir_2, Branch02=move_2.Geometry, FlattenInputs=True)  # -> simplify(Result)
neg_2 = Negative(Value=樽板_厚)
offset = OffsetCurve(Curve=entwine, Distance=neg_2, Corners=1)  # -> flatten(Curve)

# ----
# Method: 樽板外形線（曲げ後）の制御点を作成
ma_2 = MassAddition(Input=分割角度リスト)  # -> Result, PartialResults
ins_2 = InsertItems(List=ma_2.PartialResults, Item="0", Indices="0", Wrap=True)
cull_i_2 = CullIndex(List=ins_2, Indices=-1, Wrap=True)
remap = RemapNumbers(Value=cull_i_2, Source="2*pi", Target=Domain(0, 1))  # -> Mapped, Clipped
eval = EvaluateCurve(Curve=reparameterize(graft(entwine)), Parameter=remap.Mapped)  # -> simplify(Point), Tangent, Angle
eval_2 = EvaluateCurve(Curve=reparameterize(graft(offset)), Parameter=remap.Mapped)  # -> simplify(Point), Tangent, Angle
flip = FlipMatrix(Data=eval.Point)
flip_2 = FlipMatrix(Data=eval_2.Point)

樽概形_高さ_2 = Number(list_item_5)

# ----
# Method: 樽板ボリューム（曲げ後・溝なし）を作成
intcrv = Interpolate(Vertices=flip, Degree=3, Periodic=False, KnotStyle=1)  # -> Curve, Length, Domain
intcrv_2 = Interpolate(Vertices=flip_2, Degree=3, Periodic=False, KnotStyle=1)  # -> Curve, Length, Domain
merge = Merge(Data1=intcrv.Curve, Data2=intcrv_2.Curve)
loft = Loft(Curves=merge, Options={Adjust=False, Closed=False, LoftEnds=0, LoftSimp=0, LoftType=0, Rebuild=10, Refit=0.01})
crv = Curve(loft)
tstat = TreeStatistics(Tree=crv)  # -> Paths, Length, Count
shift = ShiftList(List=tstat.Paths, Shift=1, Wrap=True)
branch = TreeBranch(Tree=crv, Path=shift, MaintainPaths=False)
merge_2 = Merge(Data1=crv, Data2=branch)
loft_2 = Loft(Curves=merge_2, Options={Adjust=False, Closed=False, LoftEnds=0, LoftSimp=0, LoftType=0, Rebuild=10, Refit=0.01})
cap = CapHoles(Brep=loft_2)

樽概形_高さ_2_2 = Number(division_2)

# ----
# Method: 樽板ボリューム（曲げ前）作成用の被投影サーフェスを作成
tstat_2 = TreeStatistics(Tree=eval.Point)  # -> Paths, Length, Count
item_2 = ListItem(List=tstat_2.Paths, Index=1, Wrap=True)
branch_2 = TreeBranch(Tree=eval.Point, Path=item_2, MaintainPaths=True)
shift_2 = ShiftList(List=branch_2, Shift=1, Wrap=True)
multiplication = Multiplication(A=樽概形_高さ_2_2, B=rhino許容誤差_1_tol)
multiplication_2 = Multiplication(A=rhino許容誤差_2, B="2")
multiplication_3 = Multiplication(A=樽概形_中央の直径_2, B=rhino許容誤差_2)
ln = Line(StartPoint=branch_2, EndPoint=shift_2)
neg_3 = Negative(Value=multiplication)
addition_3 = Addition(A=multiplication_2, B=1)
multiplication_4 = Multiplication(A=樽概形_高さ_2, B=addition_3)
offset_2 = OffsetCurve(Curve=ln, Distance=multiplication_3, Corners=1)  # -> simplify(Curve)
Z_4 = UnitZ(Factor=neg_3)
Z_5 = UnitZ(Factor=multiplication_4)
move_3 = Move(Geometry=offset_2, Motion=Z_4)  # -> Geometry, Transform
extr = Extrude(Base=move_3.Geometry, Direction=Z_5)

樽概形_高さ_3 = Number(list_item_5)
樽概形_中央の直径_2_2 = Number(division_4)
樽概形_高さ_4 = Number(list_item_5)

# ----
# Method: 樽板ボリューム（曲げ後・溝あり）を作成
Z_6 = UnitZ(Factor=溝_樽端部から溝芯までの距離_2)
move_4 = Move(Geometry=基準点_樽_3, Motion=Z_6)  # -> Geometry, Transform
pcx = CurvePlane(Curve=intcrv_2.Curve, Plane=move_4.Geometry)  # -> simplify(Points), ParamsC, ParamsP
dist = Distance(PointA=move_4.Geometry, PointB=pcx.Points)  # -> flatten(Distance)
sort = SortList(Keys=dist)  # -> Keys, ValuesA
item_3 = ListItem(List=sort.Keys, Index=0, Wrap=True)
division_5 = Division(A=溝_幅_2, B=2)
addition_4 = Addition(A=item_3, B=溝_深さ_2)
neg_4 = Negative(Value=division_5)
cir_3 = Circle(Plane=move_4.Geometry, Radius=addition_4)
Z_7 = UnitZ(Factor=neg_4)
multiplication_5 = Multiplication(A=addition_4, B=2)
move_5 = Move(Geometry=cir_3, Motion=Z_7)  # -> Geometry, Transform
multiplication_6 = Multiplication(A=溝_樽端部から溝芯までの距離_2, B=2)
Z_8 = UnitZ(Factor=溝_幅_2)
subtraction = Subtraction(A=樽概形_高さ_3, B=multiplication_6)
srf = Surface(move_5.Geometry)
extr_2 = Extrude(Base=srf, Direction=Z_8)
Z_9 = UnitZ(Factor=subtraction)
move_6 = Move(Geometry=extr_2, Motion=Z_9)  # -> Geometry, Transform
merge_3 = Merge(Data1=extr_2, Data2=move_6.Geometry)

# ----
# Method: 容積を算出
intcrv_3 = Interpolate(Vertices=flip_2, Degree=3, Periodic=False, KnotStyle=1)  # -> Curve, Length, Domain
tstat_3 = TreeStatistics(Tree=intcrv_3.Curve)  # -> Paths, Length, Count
division_6 = Division(A=鏡板_厚_2, B=2)
shift_3 = ShiftList(List=tstat_3.Paths, Shift=1, Wrap=True)
addition_5 = Addition(A=溝_樽端部から溝芯までの距離_3, B=division_6)
branch_3 = TreeBranch(Tree=intcrv_3.Curve, Path=shift_3, MaintainPaths=False)
Z_10 = UnitZ(Factor=addition_5)
multiplication_7 = Multiplication(A=溝_樽端部から溝芯までの距離_3, B=2)
merge_4 = Merge(Data1=intcrv_3.Curve, Data2=branch_3)
move_7 = Move(Geometry=基準点_樽_4, Motion=Z_10)  # -> Geometry, Transform
addition_6 = Addition(A=multiplication_7, B=鏡板_厚_2)
loft_3 = Loft(Curves=merge_4, Options={Adjust=False, Closed=False, LoftEnds=0, LoftSimp=0, LoftType=0, Rebuild=10, Refit=0.01})
xy_2 = XYPlane(Origin=move_7.Geometry)
multiplication_8 = Multiplication(A=樽概形_中央の直径_2_2, B=rhino許容誤差_1_tol_2)
subtraction_2 = Subtraction(A=樽概形_高さ_4, B=addition_6)
join = BrepJoin(Breps=flatten(loft_3))  # -> Breps, Closed
cyl = Cylinder(Base=xy_2, Radius=multiplication_8, Length=subtraction_2)
cap_2 = CapHoles(Brep=join.Breps)
cap_3 = CapHoles(Brep=cyl)
sint = SolidIntersection(BrepsA=cap_2, BrepsB=cap_3)
volume = Volume(Geometry=sint)  # -> Volume, Centroid
division_7 = Division(A=volume.Volume, B=1000000)

樽概形_高さ_5 = Number(list_item_5)
樽概形_高さ_6 = Number(list_item_5)

# ----
# Method: 鏡板を作成
division_8 = Division(A=鏡板_厚_3, B=2)
neg_5 = Negative(Value=division_8)
multiplication_9 = Multiplication(A=溝_樽端部から溝芯までの距離_4, B=2)
Z_11 = UnitZ(Factor=neg_5)
subtraction_3 = Subtraction(A=樽概形_高さ_5, B=multiplication_9)
move_8 = Move(Geometry=cir_3, Motion=Z_11)  # -> Geometry, Transform
Z_12 = UnitZ(Factor=subtraction_3)
Z_13 = UnitZ(Factor=鏡板_厚_3)
srf_2 = Surface(move_8.Geometry)

# ----
# Method: 樽板外形線（曲げ前）を作成
debrep = DeconstructBrep(Brep=loft_2)  # -> Faces, Edges, Vertices
xy_3 = XYPlane(Origin=基準点_樽_5)
xz = XZPlane(Origin=基準点_樽_5)
item_4 = ListItem(List=debrep.Faces, Index=0, Wrap=True)
rotate = Rotate(Geometry=xz, Angle=division, Plane=xy_3)  # -> Geometry, Transform
debrep_2 = DeconstructBrep(Brep=loft_2)  # -> Faces, Edges, Vertices
sec = BrepPlane(Brep=item_4, Plane=graft(rotate.Geometry))  # -> simplify(Curves), Points
item_5 = ListItem(List=debrep_2.Faces, Index=2, Wrap=True)
len = Length(Curve=sec.Curves)
project = ProjectCurve(Curve=simplify(item_4), Brep=simplify(extr), Direction=simplify(vrot))  # -> simplify(Curve)
project_2 = ProjectCurve(Curve=simplify(item_5), Brep=simplify(extr), Direction=simplify(vrot))  # -> simplify(Curve)
division_9 = Division(A=len, B=樽概形_高さ_6)
division_10 = Division(A=len, B=樽概形_高さ_6)
scale_nu = ScaleNU(Geometry=project, Plane=PlaneXY(0, 0, 0), ScaleX=1, ScaleY=1, ScaleZ=division_9)  # -> Geometry, Transform
scale_nu_2 = ScaleNU(Geometry=project_2, Plane=PlaneXY(0, 0, 0), ScaleX=1, ScaleY=1, ScaleZ=division_10)  # -> Geometry, Transform

# ----
# 鏡板_直径
panel_3 = Panel(multiplication_5)

extr_3 = Extrude(Base=srf_2, Direction=Z_13)
move_9 = Move(Geometry=extr_3, Motion=Z_12)  # -> Geometry, Transform
sdiff = SolidDifference(BrepsA=cap, BrepsB=merge_3)

# ----
# 容積
panel_4 = Panel(division_7)

# ----
# Method: 樽板ボリューム（曲げ前）を作成
Z_14 = UnitZ(Factor=1)
midpt = CurveMiddle(Curve=move_3.Geometry)
vrot_2 = Rotate(Vector=vrot, Axis=Z_14, Angle="pi/2")
rot3d = Rotate3D(Geometry=scale_nu.Geometry, Angle=1.570796327, Center=midpt, Axis=vrot_2)  # -> Geometry, Transform
rot3d_2 = Rotate3D(Geometry=scale_nu_2.Geometry, Angle=1.570796327, Center=midpt, Axis=vrot_2)  # -> Geometry, Transform
Z_15 = UnitZ(Factor=樽板_厚_2)
move_10 = Move(Geometry=rot3d_2.Geometry, Motion=Z_15)  # -> Geometry, Transform
explode = Explode(Curve=rot3d.Geometry, Recursive=True)  # -> Segments, Vertices
explode_2 = Explode(Curve=move_10.Geometry, Recursive=True)  # -> Segments, Vertices
cull_i_3 = CullIndex(List=explode_2.Vertices, Indices=-1, Wrap=True)
item_6 = ListItem(List=explode.Vertices, Index=0, Wrap=True)
cp = ClosestPoint(Point=item_6, Cloud=cull_i_3)  # -> ClosestPoint, CPIndex, Distance
crv_cp = CurveClosestPoint(Point=cp.ClosestPoint, Curve=move_10.Geometry)  # -> Point, Parameter, Distance
seam = Seam(Curve=move_10.Geometry, Seam=crv_cp.Parameter)  # -> simplify(Curve)
flip_3 = FlipCurve(Curve=seam)  # -> Curve, Flag
merge_5 = Merge(Data1=rot3d.Geometry, Data2=flip_3.Curve)
loft_4 = Loft(Curves=merge_5, Options={Adjust=False, Closed=False, LoftEnds=0, LoftSimp=0, LoftType=0, Rebuild=10, Refit=0.01})
cap_4 = CapHoles(Brep=loft_4)

# ----
# Method: unique樽板のツリーパスを取得
cset = CreateSet(List=分割角度リスト_3)  # -> Set, Map
tstat_4 = TreeStatistics(Tree=cap_4)  # -> Paths, Length, Count
cset_2 = CreateSet(List=cset.Map)  # -> Set, Map
mindex = MemberIndex(Set=cset.Map, Member=cset_2.Set)  # -> Index, Count
item_7 = ListItem(List=mindex.Index, Index=0, Wrap=True)
item_8 = ListItem(List=tstat_4.Paths, Index=item_7, Wrap=True)

unique樽板ツリーパス = DataPath(item_8)
panel_5 = Panel(unique樽板ツリーパス)

# ----
# Method: 治具レイアウト基準点を作成
lng = ListLength(List=flatten(unique樽板ツリーパス))
series = Series(Start=0, Step=レイアウト_治具_unique間隔_2, Count=lng)
X_2 = UnitX(Factor=series)
merge_6 = Merge(Data1="0", Data2=レイアウト_治具_ab間隔_2)
move_11 = Move(Geometry=基準点_治具_2, Motion=X_2)  # -> graft(Geometry), Transform
Y = UnitY(Factor=merge_6)
move_12 = Move(Geometry=move_11.Geometry, Motion=Y)  # -> simplify(graft(Geometry)), Transform

# ----
# Method: ツリーパスを正規化
tstat_5 = TreeStatistics(Tree=move_12.Geometry)  # -> Paths, Length, Count
dpath = DeconstructPath(Branch=tstat_5.Paths)
item_9 = ListItem(List=dpath, Index=0, Wrap=True)
tstat_6 = TreeStatistics(Tree=item_9)  # -> Paths, Length, Count
replace = ReplacePaths(Data=item_9, Search=tstat_6.Paths, Replace=tstat_5.Paths)

# ----
# Method: unique樽板配置角
branch_4 = TreeBranch(Tree=simplify(graft(division)), Path=unique樽板ツリーパス, MaintainPaths=False)

# ----
# Method: unique樽板ボリューム
branch_5 = TreeBranch(Tree=cap_4, Path=unique樽板ツリーパス, MaintainPaths=False)

panel_6 = Panel(replace)
正規ツリーパス = Integer(replace)

# ----
# Method: unique樽板ボリューム（曲げ前）の底面・側面を抽出
debrep_3 = DeconstructBrep(Brep=branch_5)  # -> Faces, Edges, Vertices
area = Area(Geometry=debrep_3.Faces)  # -> Area, Centroid
sort_2 = SortList(Keys=area.Area, ValuesA=debrep_3.Faces)  # -> Keys, ValuesA
item_10 = ListItem(List=sort_2.ValuesA, Index=-1, Wrap=True)  # -> simplify(Item)
item_11 = ListItem(List=sort_2.ValuesA, Index=2, Wrap=True)
item_12 = ListItem(List=flatten(item_10), Index=正規ツリーパス, Wrap=True)

unique樽板ツリーパス_2 = DataPath(item_8)
unique樽板ツリーパス_3 = DataPath(item_8)
lng_2 = ListLength(List=flatten(unique樽板ツリーパス))
正規ツリーパス_2 = Integer(replace)

# ----
# Method: unique樽板の底面を配置
yz = YZPlane(Origin=基準点_樽_6)
xy_4 = XYPlane(Origin=基準点_樽_6)
rotate_2 = Rotate(Geometry=yz, Angle=branch_4, Plane=xy_4)  # -> Geometry, Transform
volume_2 = Volume(Geometry=branch_5)  # -> Volume, Centroid
pl_origin = PlaneOrigin(Base=rotate_2.Geometry, Origin=volume_2.Centroid)
xy_5 = XYPlane(Origin=Point(0, 0, 0))
sec_2 = BrepPlane(Brep=item_11, Plane=pl_origin)  # -> simplify(Curves), Points
sec_3 = BrepPlane(Brep=item_10, Plane=pl_origin)  # -> simplify(Curves), Points
branch_6 = TreeBranch(Tree=simplify(graft(midpt)), Path=unique樽板ツリーパス_3, MaintainPaths=False)
rotate_3 = Rotate(Geometry=xy_5, Angle=branch_4, Plane=xy_5)  # -> Geometry, Transform
end = EndPoints(Curve=sec_2.Curves)  # -> Start, End
end_2 = EndPoints(Curve=sec_3.Curves)  # -> Start, End
vec2pt = Vector2Pt(PointA=end.Start, PointB=end.End, Unitize=False)  # -> Vector, Length
vec2pt_2 = Vector2Pt(PointA=end_2.Start, PointB=end_2.End, Unitize=False)  # -> Vector, Length
pl_origin_2 = PlaneOrigin(Base=rotate_3.Geometry, Origin=branch_6)
xy_6 = XYPlane(Origin=move_12.Geometry)
angle = Angle(VectorA=vec2pt.Vector, VectorB=vec2pt_2.Vector)  # -> Angle, Reflex
item_13 = ListItem(List=flatten(pl_origin_2), Index=正規ツリーパス_2, Wrap=True)
subtraction_4 = Subtraction(A=1.570796327, B=angle.Angle)
orient = Orient(Geometry=item_12, Source=item_13, Target=xy_6)  # -> Geometry, Transform
item_14 = ListItem(List=flatten(subtraction_4), Index=正規ツリーパス_2, Wrap=True)
yz_2 = YZPlane(Origin=move_12.Geometry)
rotate_4 = Rotate(Geometry=orient.Geometry, Angle=item_14, Plane=yz_2)  # -> Geometry, Transform
Z_16 = UnitZ(Factor=治具_厚_2)
move_13 = Move(Geometry=rotate_4.Geometry, Motion=Z_16)  # -> Geometry, Transform

series_2 = Series(Start=0, Step=レイアウト_樽図面_unique間隔, Count=lng_2)
X_3 = UnitX(Factor=series_2)
branch_7 = TreeBranch(Tree=rot3d.Geometry, Path=unique樽板ツリーパス_2, MaintainPaths=False)
branch_8 = TreeBranch(Tree=rot3d_2.Geometry, Path=unique樽板ツリーパス_2, MaintainPaths=False)
move_14 = Move(Geometry=基準点_樽板図面_2, Motion=X_3)  # -> simplify(graft(Geometry)), Transform
merge_7 = Merge(Data1=branch_7, Data2=branch_8)
pl_origin_3 = PlaneOrigin(Base=rotate_3.Geometry, Origin=branch_6)
orient_2 = Orient(Geometry=merge_7, Source=pl_origin_3, Target=move_14.Geometry)  # -> Geometry, Transform
unique樽板ツリーパス_4 = DataPath(item_8)
正規ツリーパス_3 = Integer(replace)
area_2 = Area(Geometry=orient_2.Geometry)  # -> Area, Centroid

# ----
# Method: 治具概形断面を作成
item_15 = ListItem(List=tstat_2.Paths, Index=0, Wrap=True)
branch_9 = TreeBranch(Tree=eval.Point, Path=item_15, MaintainPaths=True)
shift_4 = ShiftList(List=branch_9, Shift=1, Wrap=True)
len_2 = Length(Curve=ln)
ln_2 = Line(StartPoint=branch_9, EndPoint=shift_4)
branch_10 = TreeBranch(Tree=simplify(graft(len_2)), Path=unique樽板ツリーパス_4, MaintainPaths=False)
len_3 = Length(Curve=ln_2)
branch_11 = TreeBranch(Tree=simplify(graft(len_3)), Path=unique樽板ツリーパス_4, MaintainPaths=False)
division_11 = Division(A=branch_10, B=2)
addition_7 = Addition(A=治具共通_突起最小幅_2, B=division_11)
Y_2 = UnitY(Factor=1)
X_4 = UnitX(Factor=1)
division_12 = Division(A=branch_11, B=2)
item_16 = ListItem(List=flatten(addition_7), Index=正規ツリーパス_3, Wrap=True)
vrot_3 = Rotate(Vector=Y_2, Axis=X_4, Angle=item_14)
item_17 = ListItem(List=flatten(division_12), Index=正規ツリーパス_3, Wrap=True)
multiplication_10 = Multiplication(A=item_16, B=vrot_3)
multiplication_11 = Multiplication(A=item_17, B=vrot_3)
Z_17 = UnitZ(Factor=治具_厚_3)
move_15 = Move(Geometry=move_12.Geometry, Motion=Z_17)  # -> Geometry, Transform
neg_6 = Negative(Value=multiplication_11)
move_16 = Move(Geometry=move_15.Geometry, Motion=multiplication_10)  # -> Geometry, Transform
move_17 = Move(Geometry=move_15.Geometry, Motion=neg_6)  # -> Geometry, Transform
ln_3 = Line(StartPoint=move_17.Geometry, EndPoint=move_16.Geometry)
Z_18 = UnitZ(Factor=治具共通_突起段差_2)
ln_4 = Line(StartPoint=move_17.Geometry, EndPoint=move_16.Geometry)
move_18 = Move(Geometry=ln_3, Motion=Z_18)  # -> Geometry, Transform
project_3 = Project(Geometry=ln_4, Plane=PlaneXY(0, 0, 0))  # -> Geometry, Transform
merge_8 = Merge(Data1=move_18.Geometry, Data2=project_3.Geometry)
loft_5 = Loft(Curves=merge_8, Options={Adjust=False, Closed=False, LoftEnds=0, LoftSimp=0, LoftType=0, Rebuild=10, Refit=0.01})

yz_3 = YZPlane(Origin=area_2.Centroid)
pcx_2 = CurvePlane(Curve=orient_2.Geometry, Plane=yz_3)  # -> Points, ParamsC, ParamsP
item_18 = ListItem(List=flip, Index=0, Wrap=True)  # -> flatten(Item)
item_19 = ListItem(List=flip_2, Index=0, Wrap=True)  # -> flatten(Item)
item_20 = ListItem(List=pcx_2.Points, Index=0, Wrap=True)
item_21 = ListItem(List=pcx_2.Points, Index=1, Wrap=True)
shift_5 = ShiftList(List=item_18, Shift=1, Wrap=True)
shift_6 = ShiftList(List=item_19, Shift=1, Wrap=True)
dist_2 = Distance(PointA=item_18, PointB=shift_5)  # -> simplify(graft(Distance))
dist_3 = Distance(PointA=item_19, PointB=shift_6)  # -> simplify(graft(Distance))
tstat_7 = TreeStatistics(Tree=pcx_2.Points)  # -> Paths, Length, Count
branch_12 = TreeBranch(Tree=dist_2, Path=unique樽板ツリーパス_2, MaintainPaths=False)
branch_13 = TreeBranch(Tree=dist_3, Path=unique樽板ツリーパス_2, MaintainPaths=False)
dpath_2 = DeconstructPath(Branch=tstat_7.Paths)
item_22 = ListItem(List=dpath_2, Index=1, Wrap=True)
dist_4 = Distance(PointA=item_20, PointB=item_21)
merge_9 = Merge(Data1=branch_12, Data2=branch_13)  # -> graft(Result)
tstat_8 = TreeStatistics(Tree=item_22)  # -> Paths, Length, Count
bbox = BoundingBox(Content=orient_2.Geometry, Plane=PlaneXY(0, 0, 0))  # -> Box, Box_2
cluster = Cluster(基準点_樽板図面_unique別=move_14.Geometry, 樽板_厚=樽板_厚, unique数=lng_2, 正規ツリーパス=tstat_7.Paths, 幅リスト=dist_4)  # -> crv_2, G
cluster_2 = Cluster(基準点_樽板図面_unique別=move_14.Geometry, 樽板_厚=樽板_厚, unique数=lng_2, 正規ツリーパス=tstat_7.Paths, 幅リスト=merge_9)  # -> crv_2, G
item_23 = ListItem(List=bbox.Box, Index=0, Wrap=True)
replace_2 = ReplacePaths(Data=item_22, Search=tstat_8.Paths, Replace=tstat_7.Paths)
eval_3 = Evaluate(E="2*x-1", x=replace_2)
item_24 = ListItem(List=cluster_2.G, Index=0, Wrap=True)
item_25 = ListItem(List=cluster_2.G, Index=1, Wrap=True)
box = EvaluateBox(Box=item_23, UParameter="0", VParameter="0", WParameter=0.5)  # -> Plane, Point, Include
box_2 = EvaluateBox(Box=item_23, UParameter="1", VParameter="0", WParameter=0.5)  # -> Plane, Point, Include
multiplication_12 = Multiplication(A=eval_3, B=Slider(20, range=0..50))
dimaligned = AlignedDimension(
    Plane=xy,
    PointA=item_20,
    PointB=item_21,
    Offset=multiplication_12,
    TextSettings=as_text.TextSettings,
    DimensionSettings=as_dimension.DimensionSettings,
    ArrowSettings=as_arrows.ArrowSettings)  # -> AlignedDimension, Plane, PointA, PointB, Offset, TextOverride, Style, TextSettings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
dimaligned_2 = AlignedDimension(
    Plane=xy,
    PointA=box.Plane,
    PointB=box_2.Plane,
    Offset=neg,
    TextSettings=as_text.TextSettings,
    DimensionSettings=as_dimension.DimensionSettings,
    ArrowSettings=as_arrows.ArrowSettings)  # -> AlignedDimension, Plane, PointA, PointB, Offset, TextOverride, Style, TextSettings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
dimaligned_3 = AlignedDimension(
    Plane=xy,
    PointA=item_24,
    PointB=item_25,
    Offset=multiplication_12,
    TextSettings=as_text.TextSettings,
    DimensionSettings=as_dimension_2.DimensionSettings,
    ArrowSettings=as_arrows.ArrowSettings)  # -> AlignedDimension, Plane, PointA, PointB, Offset, TextOverride, Style, TextSettings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
item_26 = ListItem(List=cluster.G, Index=0, Wrap=True)
item_27 = ListItem(List=cluster.G, Index=1, Wrap=True)
linear_dimension = LinearDimension(dimaligned.AlignedDimension)
linear_dimension_2 = LinearDimension(dimaligned_2.AlignedDimension)
linear_dimension_3 = LinearDimension(dimaligned_3.AlignedDimension)
pshift = ShiftPaths(Data=item_26, Offset=-1)
pshift_2 = ShiftPaths(Data=item_27, Offset=-1)
item_28 = ListItem(List=pshift, Index=0, Wrap=True)
item_29 = ListItem(List=pshift, Index=1, Wrap=True)
item_30 = ListItem(List=pshift_2, Index=0, Wrap=True)
crv_2 = Curve(orient_2.Geometry)
crv_3 = Curve(cluster.crv_2)
crv_4 = Curve(cluster_2.crv_2)
vec2pt_3 = Vector2Pt(PointA=item_28, PointB=item_30, Unitize=True)  # -> Vector, Length
unique樽板ツリーパス_5 = DataPath(item_8)
vec2pt_4 = Vector2Pt(PointA=item_28, PointB=item_29, Unitize=True)  # -> Vector, Length
正規ツリーパス_4 = Integer(replace)
multiplication_13 = Multiplication(A=vec2pt_4.Vector, B=number_slider)
multiplication_14 = Multiplication(A=vec2pt_3.Vector, B=number_slider)

# ----
# Method: 治具概形ボリュームを作成
branch_14 = TreeBranch(Tree=simplify(graft(len)), Path=unique樽板ツリーパス_5, MaintainPaths=False)
neg_7 = Negative(Value=治具共通_クランプ基部長さ_2)
item_31 = ListItem(List=flatten(branch_14), Index=正規ツリーパス_4, Wrap=True)
multiplication_15 = Multiplication(A=治具共通_クランプ基部長さ_2, B=2)
X_5 = UnitX(Factor=neg_7)
addition_8 = Addition(A=multiplication_15, B=item_31)
move_19 = Move(Geometry=loft_5, Motion=X_5)  # -> Geometry, Transform
X_6 = UnitX(Factor=addition_8)
extr_4 = Extrude(Base=move_19.Geometry, Direction=X_6)

# ----
# Method: unique樽板の底面をスケーリング
panel_7 = Panel("1")
merge_10 = Merge(Data1=panel_7, Data2=治具a_スケーリング_2)
multiplication_16 = Multiplication(A=lng, B=2)
repeat = RepeatData(Data=merge_10, Length=multiplication_16)  # -> simplify(graft(Data))
area_3 = Area(Geometry=move_13.Geometry)  # -> Area, Centroid
tstat_9 = TreeStatistics(Tree=repeat)  # -> Paths, Length, Count
pl_origin_4 = PlaneOrigin(Base=xy_6, Origin=area_3.Centroid)
replace_3 = ReplacePaths(Data=repeat, Search=tstat_9.Paths, Replace=tstat_5.Paths)
scale_nu_3 = ScaleNU(Geometry=move_13.Geometry, Plane=pl_origin_4, ScaleX=1, ScaleY=replace_3, ScaleZ=replace_3)  # -> Geometry, Transform

neg_8 = Negative(Value=multiplication_13)
neg_9 = Negative(Value=multiplication_14)
move_20 = Move(Geometry=item_28, Motion=neg_8)  # -> Geometry, Transform
move_21 = Move(Geometry=item_28, Motion=neg_9)  # -> Geometry, Transform
ln_5 = Line(StartPoint=item_28, EndPoint=move_20.Geometry)
ln_6 = Line(StartPoint=item_28, EndPoint=move_21.Geometry)
dimangle_l = AngleDimensionLines(
    Plane=xy,
    LineA=ln_6,
    LineB=ln_5,
    TextSettings=as_text_2.TextSettings,
    DimensionSettings=as_dimension_3.DimensionSettings,
    ArrowSettings=as_arrows_2.ArrowSettings)  # -> AngleDimension, Plane, LineA, LineB, DimensionLocation, TextOverride, Style, TextSettings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

# ----
# Method: ルーター側曲面を作成
project_4 = Project(Geometry=move_13.Geometry, Plane=PlaneXY(0, 0, 0))  # -> Geometry, Transform
merge_11 = Merge(Data1=move_13.Geometry, Data2=project_4.Geometry)
loft_6 = Loft(Curves=merge_11, Options={Adjust=False, Closed=False, LoftEnds=0, LoftSimp=0, LoftType=0, Rebuild=10, Refit=0.01})
cap_5 = CapHoles(Brep=loft_6)
merge_12 = Merge(Data1=extr_4, Data2=cap_5)
sunion = SolidUnion(Breps=merge_12)

# ----
# Method: 材固定用の切りかけを作成
multiplication_17 = Multiplication(A=治具共通_突起段差_3, B=rhino許容誤差_1_tol)
Z_19 = UnitZ(Factor=multiplication_17)
extr_5 = Extrude(Base=scale_nu_3.Geometry, Direction=Z_19)

sdiff_2 = SolidDifference(BrepsA=sunion, BrepsB=extr_5)
preview = CustomPreview(
    Geometry=[sdiff_2, cap_4, sdiff, extr_3, move_9.Geometry, linear_dimension, crv_2, crv_3, crv_4, linear_dimension_2, dimangle_l.AngleDimension, linear_dimension_3],
    Material=material)

# ==== cluster Cluster
樽板_厚 = ClusterInput()
unique数 = ClusterInput()
樽板_厚_2 = Number(樽板_厚)
multiplication = Multiplication(A=unique数, B=2)
panel = Panel("""1
0""")
正規ツリーパス = ClusterInput()
幅リスト = ClusterInput()
neg = Negative(Value=樽板_厚_2)
repeat = RepeatData(Data=panel, Length=multiplication)  # -> graft(Data)
X = UnitX(Factor=neg)
基準点_樽板図面_unique別 = ClusterInput()
panel_2 = Panel("""0.5
-0.5""")
tstat = TreeStatistics(Tree=repeat)  # -> Paths, Length, Count
multiplication_2 = Multiplication(A=X, B=3)
multiplication_3 = Multiplication(A=幅リスト, B=panel_2)
replace = ReplacePaths(Data=repeat, Search=tstat.Paths, Replace=正規ツリーパス)
move = Move(Geometry=基準点_樽板図面_unique別, Motion=multiplication_2)  # -> Geometry, Transform
multiplication_4 = Multiplication(A=X, B=replace)
Y = UnitY(Factor=multiplication_3)
repeat_2 = RepeatData(Data=move.Geometry, Length=2)  # -> simplify(graft(Data))
addition = Addition(A=multiplication_4, B=Y)
move_2 = Move(Geometry=repeat_2, Motion=addition)  # -> Geometry, Transform
item = ListItem(List=move_2.Geometry, Index=0, Wrap=True)
item_2 = ListItem(List=move_2.Geometry, Index=1, Wrap=True)
ln = Line(StartPoint=item, EndPoint=item_2)
pshift = ShiftPaths(Data=ln, Offset=-1)
loft = Loft(Curves=pshift, Options={Adjust=False, Closed=False, LoftEnds=0, LoftSimp=0, LoftType=0, Rebuild=10, Refit=0.01})
crv = Curve(loft)
crv_2 = ClusterOutput(crv)
G = ClusterOutput(move_2.Geometry)
